# Grasshopper definition grasshopper_to_place_cone.gh (Grasshopper 1.0.8)

pt = Point(Point(2409.247621, 1159.851361, 1369.105749))
pt_2 = Point(Point(0, 0, 0))
brep = Brep(<brep referenced from the Rhino model>)
panel = Panel(Slider(80, range=0..1000))
panel_2 = Panel(Slider(150, range=0..5000))
panel_3 = Panel(Slider(406.4, range=0..1000))
vec2pt = Vector2Pt(PointA=pt_2, PointB=pt, Unitize=False)  # -> Vector, Length
series = Series(Start=0, Step=Slider(200, range=0..1000), Count=Slider(5, range=1..50))
pt_3 = ConstructPoint(XCoordinate=panel, YCoordinate=panel_2, ZCoordinate=0)
subtraction = Subtraction(A=panel_3, B=panel)
addition = Addition(A=panel_2, B=Slider(157, range=-1000..1000))
rectangle = Rectangle(Plane=PlaneXY(0, 0, 0), XSize=panel_3, YSize=Slider(2679.7, range=0..5000), Radius=0)  # -> Rectangle, Length
move = Move(Geometry=rectangle.Rectangle, Motion=vec2pt.Vector)  # -> Geometry, Transform
pt_4 = ConstructPoint(XCoordinate=subtraction, YCoordinate=addition, ZCoordinate=0)
Y = UnitY(Factor=series)
merge = Merge(Data1=pt_3, Data2=pt_4)
move_2 = Move(Geometry=graft(merge), Motion=Y)  # -> Geometry, Transform
move_3 = Move(Geometry=move_2.Geometry, Motion=vec2pt.Vector)  # -> Geometry, Transform
move_4 = Move(Geometry=brep, Motion=move_3.Geometry)  # -> Geometry, Transform
preview = CustomPreview(Geometry=[move_4.Geometry, move.Geometry], Material=ColourSwatch(SwatchColor=RGB(54, 91, 186)))
lng = ListLength(List=flatten(move_4.Geometry))
panel_4 = Panel(lng)
